# Dynamo graph RectangleUnitsExample.dyn (Dynamo 3.1.0.3411)

number = DoubleInput(10)
number_2 = DoubleInput(5)
rectangleExample = SampleZeroTouchUnits.RectangleExample.RectangleExample(width=number, length=number_2)  # graph output
units = Units("Centimeters")
getLength = SampleZeroTouchUnits.RectangleExample.GetLength(rectangleExample=rectangleExample, targetUnit=units)
watch = Watch(getLength)
units_2 = Units("Meters")
getWidth = SampleZeroTouchUnits.RectangleExample.GetWidth(rectangleExample=rectangleExample, targetUnit=units_2)
watch_2 = Watch(getWidth)
units_3 = Units("Square feet")
getArea = SampleZeroTouchUnits.RectangleExample.GetArea(rectangleExample=rectangleExample, targetUnit=units_3)
watch_3 = Watch(getArea)
