# Dynamo graph testPeriodicTransform.dyn (Dynamo 1.1.1.2316)

code_block = CodeBlock { 5; }
byCenterPointRadius = Sphere.ByCenterPointRadius(radius=code_block)
code_block_2 = CodeBlock { 5; }
scale = Geometry.Scale(geometry=byCenterPointRadius, yamount=code_block_2)
byGeometry = SampleLibraryZeroTouch.Examples.TransformableExample.byGeometry(scale)
byOrigin = CoordinateSystem.ByOrigin()
byCoordinates = Point.ByCoordinates()
ZAxis = Vector.ZAxis()
increment = SampleLibraryZeroTouch.Examples.PeriodicIncrement.Increment()
rotate = CoordinateSystem.Rotate(coordinateSystem=byOrigin, origin=byCoordinates, axis=ZAxis, degrees=increment)
transformObject = SampleLibraryZeroTouch.Examples.TransformableExample.TransformObject(byGeometry, rotate)
